# Grasshopper definition TestGhDefinition.gh (Grasshopper 1.0.7)

subtraction = Subtraction(A=0, B=100)
xy = XYPlane(Origin=Point(0, 0, 0))
series = Series(Start=-100, Step=1, Count=200)
series_2 = Series(Start=-100, Step=1, Count=200)
X = UnitX(Factor=subtraction)
move = Move(Geometry=xy, Motion=X)  # -> Geometry, Transform
Y = UnitY(Factor=subtraction)
crossref = CrossReference(ListA=series, ListB=series_2, CrossMode=1)  # -> ListA, ListB
move_2 = Move(Geometry=move.Geometry, Motion=Y)  # -> Geometry, Transform
sqgrid = Square(Plane=move_2.Geometry, Size=1, ExtentX=Slider(200, range=0..1000), ExtentY=Slider(200, range=0..1000))  # -> Cells, Points
pdecon = Deconstruct(Point=sqgrid.Points)  # -> XComponent, YComponent, ZComponent
c_script = CSharpScript(x=pdecon.XComponent, y=pdecon.YComponent)  # -> out, A, B, C; inputs x: Double, y: Double
# ---------- c_script: C# ----------
    //evaluate binary f6 function for x and y values
    var num1 = Math.Pow(Math.Sin(Math.Sqrt(x * x + y * y)), 2);
    var num2 = Math.Pow(1 + 0.001 * (x * x + y * y), 2);
    var result = 0.5 + (num1 - 0.5) / num2;
    A = num1;
    A = num2;
    C = result;
# ---------- end c_script ----------
bnd = Bounds(Numbers=c_script.B)
multiplication = Multiplication(A=c_script.C, B=100)
pt = ConstructPoint(XCoordinate=pdecon.XComponent, YCoordinate=pdecon.YComponent, ZCoordinate=multiplication)
